# Grasshopper definition gridstructure_plain.gh (Grasshopper 1.0.7)

# ----
# base layer: e.g. circle
radius = Slider(37, range=0..100)
origin = Panel("0,0,0")
circle_cnr = CircleCNR(Center=origin, Normal=Vector(0, 0, 1), Radius=radius)

# ----
# first layer height
geometry = Geometry(circle_cnr)
unit_z = UnitZ(Factor=Slider(0.7, range=0..2))
move = Move(Geometry=geometry, Motion=unit_z)  # -> Geometry, Transform
geometry_2 = Geometry(move.Geometry)

# ---- group: grid width / vertical layer height
# grid width
number_slider = Slider(2.4, range=0..6)

# ---- group: grid width
# change direction in x-axis (normally z)
panel = Panel("1,0,0")
contour = Contour(Shape=geometry_2, Point=Point(0, 0, 0), Direction=panel, Distance=number_slider)  # -> flatten(Contours)
panel_2 = Panel(contour)

# ----
curve = Curve(contour)

# ---- group: get rid of first an last row
cull_index = CullIndex(List=curve, Indices="0", Wrap=True)
cull_index_2 = CullIndex(List=cull_index, Indices="-1", Wrap=True)

# ---- group: pre selction of lines
# pre-selection of lines
pattern_for_line_selection = Panel("""0
1""")
curve_2 = Curve(cull_index_2)
dispatch = Dispatch(List=curve_2, DispatchPattern=pattern_for_line_selection)  # -> ListA, ListB
curve_3 = Curve(dispatch.ListB)
curve_4 = Curve(dispatch.ListA)

# ----
number_of_deflection = Slider(9, range=1..50)
amplitude_in_normal_direction = Slider(3, range=0..10)

# ---- group: weave_gesamt
integer = Integer(pattern_for_line_selection)
expression = Expression(x=integer, Expression="If(x=0,1,0)")
panel_3 = Panel(expression)

# ----
# for even deflection.
# for uneven deflection create another set of number sliders
amplitude_in_x_direction = Slider(8, range=0..10)

# ---- group: Linien_1_Auslenkung
curve_5 = Curve(curve_4)
base_geo = Geometry(geometry_2)
# first set of lines
pattern_for_point_selection = Panel("""0
0
1
1""")
divide_curve = DivideCurve(Curve=curve_5, Count=number_of_deflection, Kinks=False)  # -> Points, Tangents, Parameters
integer_2 = Integer(pattern_for_point_selection)
dispatch_2 = Dispatch(List=divide_curve.Points, DispatchPattern=pattern_for_point_selection)  # -> ListA, ListB
expression_2 = Expression(x=integer_2, Expression="If(x=0,1,0)")
point = Point(dispatch_2.ListB)
point_2 = Point(dispatch_2.ListA)
panel_4 = Panel(expression_2)
brep_cp = BrepClosestPoint(Point=point_2, Brep=base_geo)  # -> Point, Normal, Distance
amp = Amplitude(Vector=brep_cp.Normal, Amplitude=amplitude_in_normal_direction)
move_2 = Move(Geometry=brep_cp.Point, Motion=amp)  # -> Geometry, Transform
X = UnitX(Factor=amplitude_in_x_direction)
move_3 = Move(Geometry=move_2.Geometry, Motion=expr("x*-1", X))  # -> Geometry, Transform
weave = Weave(Pattern=panel_4, Stream0=move_3.Geometry, Stream1=point, NullGaps=False)

# ---- group: Linien_2_Auslenkung
curve_6 = Curve(curve_3)
number_slider_2 = Slider(13, range=1..50)
base_geo_2 = Geometry(geometry_2)
# second set of line
punktauswahl = Panel("""1
1
0
0""")
divide_curve_2 = DivideCurve(Curve=curve_6, Count=number_of_deflection, Kinks=False)  # -> Points, Tangents, Parameters
integer_3 = Integer(pattern_for_point_selection)
dispatch_3 = Dispatch(List=divide_curve_2.Points, DispatchPattern=pattern_for_point_selection)  # -> ListA, ListB
expression_3 = Expression(x=integer_3, Expression="If(x=0,1,0)")
point_3 = Point(dispatch_3.ListB)
point_4 = Point(dispatch_3.ListA)
panel_5 = Panel(expression_3)
number_slider_3 = Slider(3, range=0..10)
brep_cp_2 = BrepClosestPoint(Point=point_4, Brep=base_geo_2)  # -> Point, Normal, Distance
amp_2 = Amplitude(Vector=brep_cp_2.Normal, Amplitude=amplitude_in_normal_direction)
number_slider_4 = Slider(3, range=0..10)
move_4 = Move(Geometry=brep_cp_2.Point, Motion=amp_2)  # -> Geometry, Transform
X_2 = UnitX(Factor=expr("x*-1", amplitude_in_x_direction))
move_5 = Move(Geometry=move_4.Geometry, Motion=expr("x*-1", X_2))  # -> Geometry, Transform
weave_2 = Weave(Pattern=panel_5, Stream0=move_5.Geometry, Stream1=point_3, NullGaps=False)

# ----
nurbs_curve = NurbsCurve(Vertices=weave, Degree=3, Periodic=False)  # -> Curve, Length, Domain
nurbs_curve_2 = NurbsCurve(Vertices=weave_2, Degree=3, Periodic=False)  # -> Curve, Length, Domain

# ---- group: Spiralizer
weave_3 = Weave(Pattern=panel_3, Stream0=nurbs_curve.Curve, Stream1=nurbs_curve_2.Curve, NullGaps=False)
curve_7 = Curve(weave_3)

# ----
multiplication = Multiplication(A="15", B="60")
speed = Panel(multiplication)

# ---- group: Spiralizer
# spiralizer: making one line out all defelcted lines
curve_8 = Curve(nurbs_curve.Curve)
curve_9 = Curve(nurbs_curve_2.Curve)
curve_10 = Curve(curve_7)
flip_curve = FlipCurve(Curve=curve_8)  # -> Curve, Flag
panel_6 = Panel(curve_9)
panel_7 = Panel("""0
0
1
1""")

end_points = EndPoints(Curve=curve_10)  # -> Start, End
point_5 = Point(flatten(end_points.End))
# connecting end points for outer contours
point_6 = Point(flatten(end_points.Start))
polyline = PolyLine(Vertices=point_6, Closed=False)
polyline_2 = PolyLine(Vertices=point_5, Closed=False)
outer_contours = Panel("""1
0""")
explode = Explode(Curve=polyline, Recursive=True)  # -> Segments, Vertices
explode_2 = Explode(Curve=polyline_2, Recursive=True)  # -> Segments, Vertices
dispatch_4 = Dispatch(List=explode.Segments, DispatchPattern=outer_contours)  # -> ListA, ListB
dispatch_5 = Dispatch(List=explode_2.Segments, DispatchPattern=outer_contours)  # -> ListA, ListB
curve_11 = Curve(dispatch_4.ListA)
curve_12 = Curve(dispatch_5.ListA)
curve_13 = Curve(dispatch_4.ListB)
curve_14 = Curve(dispatch_5.ListB)

merge = Merge(Data1=curve_10, Data2=curve_13, Data3=curve_12)
panel_8 = Panel(curve_12)
curve_15 = Curve(merge)
weave_4 = Weave(Pattern=[0, 1], Stream0=flatten(curve_9), Stream1=curve_12, NullGaps=False)
join_curves = JoinCurves(Curves=curve_15, Preserve=False)
panel_9 = Panel(curve_15)
weave_5 = Weave(Pattern=[0, 1], Stream0=flatten(flip_curve.Curve), Stream1=curve_13, NullGaps=False)
param_viewer = ParamViewer(join_curves)
curve_16 = Curve(weave_4)
curve_17 = Curve(weave_5)
panel_10 = Panel(curve_16)
weave_6 = Weave(Pattern=panel_7, Stream0=curve_16, Stream1=curve_17, NullGaps=False)

# ----
pattern_curves = Curve(weave_6)

curve_18 = Curve(pattern_curves)
data_dam = DataDam(DataDataA=curve_18, BufferDelay=10000000, BufferMode=0)  # -> flatten(DataDataA)
curve_19 = Curve(data_dam)

divide_length = DivideLength(Curve=curve_19, Length=Slider(1, range=0..2))  # -> flatten(Points), Tangents, Parameters

# ---- group: Punkte
discontinuity = Discontinuity(Curve=curve_19, Level=1)  # -> Points, Parameters
control_points = ControlPoints(Curve=curve_19)  # -> Points, Weights, Knots

# ----
panel_11 = Panel(divide_length.Points)
polyline_3 = PolyLine(Vertices=divide_length.Points, Closed=False)

# ---- group: Points
# deconstructing of points into coordinates
deconstruct = Deconstruct(Point=flatten(divide_length.Points))  # -> XComponent, YComponent, ZComponent
multiplication_2 = Multiplication(A=deconstruct.XComponent, B="100")
multiplication_3 = Multiplication(A=deconstruct.YComponent, B="100")
multiplication_4 = Multiplication(A=deconstruct.ZComponent, B="100")
integer_4 = Integer(multiplication_4)
integer_5 = Integer(multiplication_3)
integer_6 = Integer(multiplication_2)
division = Division(A=integer_4, B="100")
division_2 = Division(A=integer_6, B="100")
division_3 = Division(A=integer_5, B="100")

# ---- group: FLOW (E)
# calculating flowrate (extrusion rate) for points
explode_3 = Explode(Curve=polyline_3, Recursive=True)  # -> Segments, Vertices
length = Length(Curve=explode_3.Segments)
division_4 = Division(A=length, B=Slider(6.6, range=0..100))  # -> flatten(Result)
# set Flowrate for first point: 0
panel_12 = Panel("0")
panel_13 = Panel(length)
panel_14 = Panel(division_4)
insert_items = InsertItems(List=division_4, Item=panel_12, Indices=panel_12, Wrap=True)
mass_addition = MassAddition(Input=flatten(insert_items))  # -> Result, PartialResults
multiplication_5 = Multiplication(A=mass_addition.PartialResults, B="100")
integer_7 = Integer(multiplication_5)
division_5 = Division(A=integer_7, B="100")

# ----
# use this as first insert item if you add another gcode
panel_15 = Panel(mass_addition.Result)
panel_16 = Panel(mass_addition.PartialResults)
panel_17 = Panel(division_5)
concatenate = Concatenate(
    FragmentH="G1 ",
    FragmentG="F",
    FragmentK=multiplication,
    FragmentA=" X",
    FragmentB=division_2,
    FragmentC=" Y",
    FragmentD=division_3,
    FragmentE=" Z",
    FragmentF=division,
    FragmentI=" E",
    FragmentJ=division_5)

end_of_gcode_printer_specific_wasp_delta = Panel(""";End_of_Gcode
M104 S0
M140 S0
G92 E0
G91 Z10
G1 F300 ;E-2
G28 X0 Y0
M84
;End_END_OF_HEADER""")
grid = Panel(concatenate)
start_of_gcode_printer_specific_wasp_del = Panel("""G28 ;Home
G1 Z15.0 F6000 ;Move the platform down 15mm
;Prime the extruder
G92 E0
G1 F200 E0.2
G92 E0
M302 S0""")  # "START OF GCODE (PRINTER SPECIFIC: WASP DELTA)"
merge_2 = Merge(
    Data1=flatten(start_of_gcode_printer_specific_wasp_del),
    Data2=flatten(grid),
    Data3=flatten(end_of_gcode_printer_specific_wasp_delta))

# ----
# FINAL GCODE
# (save as textfile and add .gcode)
panel_18 = Panel(merge_2)
